# Grasshopper definition gradient.gh (Grasshopper 1.0.7)

numbers = Data([35.96, 35.96, 35.06, 33.98, 33.98, 33.08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])
range = Data([0, 20, 40, 60, 80, 100])
colors = Data([RGB(77, 138, 237), RGB(83, 215, 237), RGB(206, 233, 237), RGB(245, 245, 245), RGB(240, 212, 217), RGB(252, 114, 139)])
panel = Panel(colors)
panel_2 = Panel(numbers)
panel_3 = Panel(range)
split = TextSplit(Text=panel, Separators=",")  # -> flatten(Result)
grasshopper_cluster = GrasshopperCluster(colors=panel, numbers=panel_2, range=panel_3)
python = GhPythonScript(numbers=panel_2, colors=split, range=panel_3)  # -> out, colors_out; inputs numbers: list, colors: list of Int32, range: list
# ---------- python: Python ----------
import math
import rhinoscriptsyntax as rs


class Color:
    def __init__(self, R, G, B):
        self.R = R
        self.G = G
        self.B = B

    def __add__(self, other):
        return Color(self.R + other.R, self.G + other.G, self.B + other.B)

    def __sub__(self, other):
        return Color(self.R - other.R, self.G - other.G, self.B - other.B)

    def __mul__(self, other):
        # Color must be first item in equation.  So that's Color * number, not number * Color
        return Color(self.R * other, self.G * other, self.B * other)

    def read(self):
        return (self.R, self.G, self.B)


class Domain:
    def __init__(self, _min, _max):
        self.min = _min
        self.max = _max

    def read(self):
        return (self.min, self.max)


def remap(value, source, target):
    # source and target are Domain objects
    # value must be a single number
    # new value is clipped to target domain bounds
    new_value = ((((value - source.min) / (source.max - source.min))
                  * (target.max - target.min)) + target.min)
    if new_value > target.max:
        return target.max
    if new_value < target.min:
        return target.min
    else:
        return new_value

def chunks(list, n):
    # Yield successive n-sized chunks from list
    for i in range(0, len(list), n):
        yield tuple(list[i:i + n])


# declare variables
# gh component requires input of colors, numbers, and _range
# colors must be input as flat list of integers, which then get "chunked" into RGB tuples
colors = list(chunks(colors, 3))
colors = [Color(*x) for x in colors]
domains = zip(_range[0:-1], _range[1:])
domains = [Domain(*x) for x in domains]

# sort numbers into buckets, clip numbers outside of range
buckets = []
for number in numbers:
    for domain in domains:
        if domain.min <= number <= domain.max:
            buckets.append(domains.index(domain))
            break
        if number < domains[0].min:
            buckets.append(0)
            break
        if number > domains[-1].max:
            buckets.append(len(domains) - 1)
            break


# create list of domains that corresponds to list of numbers
source = []
for bucket in buckets:
    source.append(domains[bucket])

# remap each number to the target domain of (0, 1) from its respective source domain
target = Domain(0, 1)
source_increment = 0
positions = []
for number in numbers:
    positions.append(remap(number, source[source_increment], target))
    source_increment += 1

# create list of colors representing the difference between colors2 and colors1
colors1 = colors[0:-1]
colors2 = colors[1:]
differences = []
color1_increment = 0
for color in colors2:
    differences.append(color - colors1[color1_increment])
    color1_increment += 1

# interpolate colors
interpcolors = []
bucket_increment = 0
for position in positions:
    bucket = buckets[bucket_increment]
    interpcolors.append((differences[bucket] * position) + colors1[bucket])
    bucket_increment += 1

# "read" colors and turn them into rhino color objects
colors_out = [rs.coercecolor(color.read()) for color in interpcolors]
# ---------- end python ----------
panel_4 = Panel(grasshopper_cluster)
panel_5 = Panel(python.colors_out)

# ==== cluster GrasshopperCluster
numbers = ClusterInput()
range = ClusterInput()
colors = ClusterInput()
numbers_2 = Data(numbers)
range_2 = Data(range)
colors_2 = Colour(colors)

# ---- group: create gradient / create color buckets, with color 1 and color 2
dup = DuplicateData(Data=colors_2, Number="2", Order=Toggle(False))
panel = Panel("""0
-1""")
cull_i = CullIndex(List=dup, Indices=panel, Wrap=True)
partition = PartitionList(List=cull_i, Size="2")  # -> simplify(Chunks)

# ---- group: create gradient / filter values into buckets and remap buckets between 0 and 1
consec = ConsecutiveDomains(Numbers=range_2, Additive=Toggle(False))
fdom = FindDomain(Domains=consec, Number=numbers_2, Strict=False)  # -> Index, Neighbour
item = ListItem(List=consec, Index=fdom.Neighbour, Wrap=True)
dom = ConstructDomain(DomainStart="0", DomainEnd="1")
remap = RemapNumbers(Value=numbers_2, Source=item, Target=dom)  # -> Mapped, Clipped

# ---- group: create gradient / convert RGB values into points, because somehow this will run faster in the script than text strings
item_2 = ListItem(List=partition, Index="1", Wrap=True)  # -> flatten(Item)
item_3 = ListItem(List=partition, Index="0", Wrap=True)  # -> flatten(Item)
point = Point(item_2)
point_2 = Point(item_3)

# ---- group: create gradient
graft = GraftTree(Tree=fdom.Neighbour, IncludeEmptyLists=True, IncludeNullItems=True)  # -> simplify(Tree)

# ---- group: create gradient / determine values along color gradients
item_4 = ListItem(List=point_2, Index=graft, Wrap=True)
item_5 = ListItem(List=point, Index=graft, Wrap=True)
point_3 = Point(item_5)
point_4 = Point(item_4)
subtraction = Subtraction(A=point_3, B=point_4)
graft_2 = GraftTree(Tree=remap.Clipped, IncludeEmptyLists=True, IncludeNullItems=True)
multiplication = Multiplication(A=subtraction, B=graft_2)
addition = Addition(A=point_4, B=multiplication)
colour = Colour(addition)

# ---- group: create gradient (continued)
flatten = FlattenTree(Tree=colour, Path="{0}")

# ----
colors_out = Data(flatten)
colors_out_2 = ClusterOutput(colors_out)
